% Simulink data dictionary ElectricPowertrain_data.sldd
% references BatteryManagement_data.sldd
% references MotorControl_data.sldd
% references Contactors_data.sldd
% references Driver_data.sldd

PhysicalInputs_BUS = Simulink.Bus()
  BServiceDisconnectPos: boolean
  BServiceDisconnectNeg: boolean

PlantOutput_BUS = Simulink.Bus()
  VCUKIVT: double
  IESIVT: double
  VESDCLink: double
  VESIVT: double
  BContactorsClosed: boolean
  VESCell: double[6]
  ICUKIVT: double

ControllerCmds_BUS = Simulink.Bus()
  BMSCmds: Bus: BMSCmds_BUS
  ContactorsCmds: Bus: ContactorsCmds_BUS

tSim = Simulink.Parameter(0.005, Unit="s")  % Simulation Step Time for Electric Powertrain model